# Grasshopper definition createGHDoc_Original.gh (Grasshopper 1.0.7)

panel = Panel("https://github.com/ladybug-tools/ladybug-legacy/tree/master/src")

# ---- group: set to True to generate the book
# You need to create README.md file manually at your workingDir
toggle = BooleanToggle(False)

# ----
generate_components_page = PythonScript(workingDir="C:\Users\Mostapha\Documents\code\ladybug-primer\\", pluginGHRepo=panel, pluginName="Ladybug", export=toggle)  # -> a
# ---------- generate_components_page: Python ----------
import Grasshopper
import System.Drawing
import shutil
import os
import re
import json

def captureGrasshopperScreen(fileName, workingDirectory):
    # This script captures image from top left of Grasshopper canvas
    # Output image resolution is always 1000 px * 1000 px
    imageSettings = Grasshopper.GUI.Canvas.GH_Canvas.GH_ImageSettings()
    imageSettings.Zoom = 1.85
    canvas = Grasshopper.GH_InstanceServer.ActiveCanvas

    rect = System.Drawing.Rectangle(0,0,2,2)

    # final size 200 + (width * 2)
    imgsOfCanvas = canvas.GenerateHiResImage(rect, imageSettings)

    screenCapture = imgsOfCanvas[0][0]
    
    filePath = os.path.join(workingDirectory + "images/components/", fileName)
    
    # copy image to new filepath
    shutil.copyfile(screenCapture, filePath)
    
    # delete original image
    path = os.path.split(screenCapture)[0]
    shutil.rmtree(path)


def exportIcon(component, pluginName, workingDirectory):
    fileName = getComponentName(component) + ".png"
    filePath = os.path.join(workingDirectory + "images/icons/", fileName)
    icon = component.Icon_24x24
    icon.Save(filePath)

def getComponentByName(document, name):    
    for component in document.Objects:
        if component.Name == name: return component


def exportDescription(component, pluginName, githubFolder, githubRepo=None):
    originalName = component.Name
    
    bName = originalName.replace(pluginName + "_", "")
    name = getComponentName(component)
    description = component.Description
    
    lines = []
    # header with icon
    header = "## ![](../../images/icons/%s.png) %s"%(name, bName)
    if githubRepo:
        source = " - [[source code]](%s/%s.py)\n"%(
            githubRepo, originalName.replace(' ', '%20'))
        lines.append(header + source)
    else:
        lines.append(header + '\n')
    
    # component image
    image = "![](../../images/components/%s.png)"%(name)
    lines.append(image)
    
    # add Description
    desc = component.Description.split("Provided by ")[0].replace("\n", " ")
    lines.append("\n" + desc)
    
    try:
        #print "\nInputs:"
        lines.append("\n#### Inputs")
        
        for i in range(component.Params.Input.Count):
            
            iname = component.Params.Input[i].NickName
            
            alph = "".join(re.findall("[a-zA-Z]+", iname))
            if len(alph) == 0: continue
            
            t = ""
            if iname.startswith("_") and iname.endswith("_"):
                iname = iname[1:-1]
                t = "Default"
            elif iname.startswith("_"):
                iname = iname[1:]
                t = "Required"
            elif iname.endswith("_"):
                iname = iname[:-1]
                t = "Optional"
                
            line = "* ##### " + iname + " [" + t + "]\n" + \
                  component.Params.Input[i].Description.replace("\n", " ")
            
            lines.append(line)
            
        #print "\nOutputs:"
        lines.append("\n#### Outputs")
        
        for i in range(component.Params.Output.Count):
            iname = component.Params.Output[i].NickName
            
            alph = "".join(re.findall("[a-zA-Z]+", iname))
            if len(alph) == 0: continue
            
            line = "* ##### " + iname + "\n" + \
                  component.Params.Output[i].Description.replace("\n", " ")
            
            lines.append(line)
    except Exception, e:
        print str(e)
        
    
    # example file
    exampleLine = "\n\n[Check Hydra Example Files for %s](https://hydrashare.github.io/hydra/index.html?keywords=%s)"%(bName, originalName)
    lines.append(exampleLine)
    
    fileName = name + ".md"
    filePath = os.path.join(githubFolder + "text/components/", fileName)
    with open(filePath, "w") as outf:
        outf.write("\n".join(lines).encode("utf-8"))

def getPluginComponents(pluginName):
    components = {}
    doc = Grasshopper.Instances.ActiveCanvas.Document
    
    for proxy in Grasshopper.Instances.ComponentServer.ObjectProxies:
        if proxy.Obsolete: continue
        category = proxy.Desc.Category
        if category.strip() == pluginName:
            if str(proxy.Kind) == 'CompiledObject':
                components[proxy.Desc.Name] = proxy.CreateInstance()
            elif str(proxy.Kind) == 'UserObject':
                components[proxy.Desc.Name] = Grasshopper.Kernel.GH_UserObject(proxy.Location).InstantiateObject()
    
    return components


def createFolderStructure(githubFolder):
    
    if not os.path.isdir(githubFolder): os.mkdir(githubFolder)
    
    # create githubFolder/images
    imagesFolder = os.path.join(githubFolder, "images")
    componentsImagesFolder = os.path.join(imagesFolder, "components")
    componentsIconsFolder = os.path.join(imagesFolder, "icons")
    folders = [imagesFolder, componentsImagesFolder, componentsIconsFolder]
    [os.mkdir(folder)for folder in folders if not os.path.isdir(folder)]
    
    # create githubFolder/text
    textFolder = os.path.join(githubFolder, "text")
    categoriesFolder = os.path.join(textFolder, "categories")
    componentsFolder = os.path.join(textFolder, "components")
    folders = [textFolder, categoriesFolder, componentsFolder]
    [os.mkdir(folder)for folder in folders if not os.path.isdir(folder)]


def getComponentName(component):
    # remove illegal strings - I should have used re for this
    return component.Name.replace(pluginName + "_", "") \
             .replace(" ", "_").replace("/", "_") \
             .replace("?", "_").replace("|", "_")

componentsHeights = {}

if export:
    if not workingDir:
        # This is set to my default folder
        githubFolder = "C:/Users/Administrator/Documents/GitHub/%s-primer/"%pluginName
    else:
        githubFolder = workingDir
        
    # create the folder structure
    createFolderStructure(githubFolder)
    
    doc = Grasshopper.Instances.ActiveCanvas.Document
    
    # find all Components/UserObjects under pluging name
    components = getPluginComponents(pluginName)
    
    # Capture image
    for GHObjectName, GHObject in components.items():
        
        # add object to document
        if GHObject.Attributes:
            
            GHObject.Attributes.Pivot = System.Drawing.PointF(200, 215);
            doc.AddObject(GHObject , False, 0)
        
            # find the component by name
            component = getComponentByName(doc, GHObjectName)
        
            # capture Grasshopper screen
            captureGrasshopperScreen(getComponentName(component) + ".png", githubFolder)
        
            # export Icon
            exportIcon(component, pluginName, githubFolder)
            
            # export description
            exportDescription(component, pluginName, githubFolder, pluginGHRepo)
            
            # save Height
            componentsHeights[getComponentName(component)] = str(component.Attributes.Bounds.Height)
            
            # remove the object
            doc.RemoveObject(GHObject , False)
    
    #write height data as a json file
    with open(githubFolder + "/images/componentsHeight.json", "wb") as compHeight:
        json.dump(componentsHeights, compHeight)
    
    # write SUMMARY and text for each subcategory
    # There is a little bit of duplication here in code
    # as it used to be a separate component which I copied into this one
    exposure = {"obscure" : 100,
                "hidden" : 100,
                "primary": 1,
                "secondary": 2,
                "tertiary": 3,
                "quarternary": 4,
                "quinary": 5,
                "senary": 6,
                "septenary": 7
                }

    pluginComponents = {}
    for proxy in Grasshopper.Instances.ComponentServer.ObjectProxies:
        if proxy.Obsolete: continue
        nickName = proxy.Desc.NickName
        category = proxy.Desc.Category

        if category.strip() == pluginName:
            
            subCategory = proxy.Desc.SubCategory
            subCategories = pluginComponents.keys()
            if subCategory not in subCategories:
                pluginComponents[subCategory] = {}
            
            expo = exposure[str(proxy.Exposure).split(",")[-1].strip()]
            expos = pluginComponents[subCategory].keys()
            if expo not in expos:
                pluginComponents[subCategory][expo] = []
                
            name = getComponentName(proxy.Desc)
            pluginComponents[subCategory][expo].append(name)
    
    # generate summary file
    lines = []
    sortedSubCategories = sorted(pluginComponents.keys())
    
    header = "# Summary\n\n" + \
    "* [What is this primer?](README.md)\n" + \
    "* [Components](text/categories/README.md)"
    lines.append(header)
    
    for scategory in sortedSubCategories:
        scategoryLines = [] #collect lines for this subcategory
        
        line =  "\t* [%s](text/categories/%s.md)"%(scategory, ''.join(scategory.split()).replace("|", "_").replace("::", "_"))
        #print line
        lines.append(line)
        
        order = sorted(pluginComponents[scategory].keys())
        for num in order:
            componetList = sorted(pluginComponents[scategory][num])
            for comp in componetList:
                line = "\t\t* [%s](text/components/%s.md)"%(comp, comp.replace(" ", "_"))
                #print line
                icon = "* ![IMAGE](../../images/icons/%s.png)"%comp.replace(" ", "_")
                scategoryLines.append(icon + line.replace("\t\t*" , "").replace("text" , ".."))
                
                lines.append(line)
        
        # write md file for the category
        filepath = githubFolder + "text/categories/%s.md"%(
            ''.join(scategory.split()).replace("|", "_").replace("::", "_"))
        
        try:
            with open(filepath, "w") as tab:
                tab.write("#### Component list:\n"+ "\n".join(scategoryLines))
        except Exception as e:
            raise ValueError('{}\n{}'.format(e, filepath))
    
    filepath = githubFolder + "SUMMARY.md"
    with open(filepath, "w") as summary:
        summary.write("\n".join(lines))
    
    a = "check files at " + githubFolder
# ---------- end generate_components_page ----------
# Every component will be Inserted
# to this area to capture an image!
# 
# KEEP IT CLEAR!
panel_2 = Panel(generate_components_page)
